# Grasshopper definition MK2.gh (Grasshopper 0.9.76)
# plug-ins: Kangaroo2 Components

B = Boundary({Plane=PlaneXY(0, 0, 0), Size=Domain2(u=-10..10, v=-10..10)})
N = Count(700)
W = WidthCount(1)
mplane = MeshPlane(Boundary=B, WidthCount=W, HeightCount=W)  # -> Mesh, Area
pop2d = Populate2D(Region=B, Count=Slider(166, range=0..1000), Seed=1)
onmesh = OnMesh(Points=pop2d, Mesh=mplane.Mesh, Strength=1)
pt = Point(pop2d)
c_script = CSharpScript(
    Pts=pt,
    MaxValence=Slider(3, range=0..10),
    MaxRange=Slider(1.65, range=0..2),
    TargetLength=Slider(1.23, range=0..2),
    SnapRange=Slider(1.6, range=0..10),
    Strength=Slider(3.3, range=0..10),
    Reference="E:\NOT INSTALLED\Grasshopper plugins\Kangaroo 2\KangarooSolver.dll")  # -> out, A; inputs Pts: list of Point3d, MaxValence: Int32, MaxRange: Double, TargetLength: Double, SnapRange: Double, Strength: Double
# ---------- c_script: C# ----------
    A = new ValenceSnap(Pts, MaxValence, MaxRange, TargetLength, SnapRange, Strength);
# ---------- c_script: C# additional code ----------
  public class ValenceSnap : GoalObject
  {
    public double Strength;
    public int MaxValence;
    public double MaxRange;      //no interaction beyond this distance
    public double TargetLength;  //joined pts try to be this dist apart
    public double SnapRange;     //if within this distance of TargetLength, they are considered joined
    public int[] Valence;
    public List<Line> Lines;
    public List<List<int>> Neighbours;

    public ValenceSnap(List<Point3d> Pts, int MaxValence, double MaxRange,
      double TargetLength, double SnapRange, double Strength)
    {
      int L = Pts.Count;
      PPos = Pts.ToArray();
      Move = new Vector3d[L];
      Weighting = new double[L];

      this.MaxValence = MaxValence;
      this.MaxRange = MaxRange;
      this.TargetLength = TargetLength;
      this.SnapRange = SnapRange;
      this.Strength = Strength;

      Valence = new int[L];
      Lines = new List<Line>();
      Neighbours = new List<List<int>>();

      for(int i = 0;i < L;i++)
      {
        Neighbours.Add(new List<int>());
      }
    }

    public override void Calculate(List<KangarooSolver.Particle> p)
    {
      Lines.Clear();

      int L = PIndex.Length;

      int[] ValenceTemp = new int[L];

      double[] Xcoord = new double[L];
      for (int i = 0; i < L; i++)
      {
        Xcoord[i] = p[PIndex[i]].Position.X;
      }
      Array.Sort(Xcoord, PIndex);

      for (int i = 0; i < L; i++)
      {
        Move[i] = Vector3d.Zero;
        Weighting[i] = 0;
      }


      //for each pair
      // if dist < maxrange
      //  if snappedcount < maxsnaps
      //   pull towards targetlength
      //   if within snaprange
      //    increment snapped for both pts
      //    add a line to the output
      //  else
      //   repel
      //
      //update snapped

      //maybe also:
      //for all points with >1 connection
      // repel the neighbours from each other
      // this could prevent short closed loops

      for (int i = 0; i < (PIndex.Length - 1); i++)
      {
        for (int j = 1; (i + j) < PIndex.Length; j++)
        {
          int k = i + j;
          Vector3d Separation = p[PIndex[k]].Position - p[PIndex[i]].Position;
          if (Separation.X < MaxRange)
          {
            if (Separation.SquareLength < MaxRange * MaxRange)
            {
              Weighting[i] = Strength;
              Weighting[k] = Strength;

              double LengthNow = Separation.Length;

              if(Valence[i] <= MaxValence && Valence[k] <= MaxValence)
              {
                //   pull towards targetlength
                //   if within snaprange
                //    increment snapped for both pts
                //    add a line to the output

                double stretchfactor = 1.0 - TargetLength / LengthNow;
                Vector3d SpringMove = 0.5 * Separation * stretchfactor;
                SpringMove.Unitize();
                SpringMove *= 0.01;
                Move[i] += SpringMove;
                Move[k] -= SpringMove;

                if(Math.Abs(TargetLength - LengthNow) < SnapRange)
                {
                  ValenceTemp[i]++;
                  ValenceTemp[k]++;
                  Lines.Add(new Line(p[PIndex[k]].Position, p[PIndex[i]].Position));
                }
              }
              else
              {
                //repel
                double stretchfactor = 1.0 - MaxRange / LengthNow;
                Vector3d SpringMove = 0.5 * Separation * stretchfactor;
                Move[i] += SpringMove;
                Move[k] -= SpringMove;
              }

            }
          }

          else { break; }
        }
      }

      Valence = ValenceTemp;

      for(int i = 0; i < L;i++)
      {
      }
    }

    public override object Output(List<KangarooSolver.Particle> p)
    {
      return Lines;
    }
  }
# ---------- end c_script ----------
grab = Grab(On=True, Strength=1, Range=3)  # -> Grab, Anchors
bouncysolver = BouncySolver(
    GoalObjects=[c_script.A, onmesh, grab.Grab],
    Reset=Button(),
    Threshold=1e-15,
    Tolerance=0.01,
    Damping=0.9,
    Iterations=3,
    On=Toggle(True))  # -> I, V, O
c_script_2 = CSharpScript(x=bouncysolver.O)  # -> out, A
# ---------- c_script_2: C# ----------
    A = x as List<Line>;
# ---------- end c_script_2 ----------
metaball_t = MetaBallT(Points=bouncysolver.V, Plane=PlaneXY(0, 0, 0), Threshold=Slider(7, range=0..22))
