# Grasshopper definition Module.gh (Grasshopper 1.0.5)

# ---- group: Count
number_slider = Slider(3, range=0..10)

# ---- group: Distance betweeen Cells
number_slider_2 = Slider(14.77, range=0..100)

# ---- group: Seed
number_slider_3 = Slider(64, range=0..222)

# ----
series = Series(Start=0, Step=number_slider_2, Count=number_slider)
unit_z = UnitZ(Factor=series)
geometry = Geometry(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)
move = Move(Geometry=geometry, Motion=unit_z)  # -> Geometry, Transform
unit_x = UnitX(Factor=series)
unit_y = UnitY(Factor=series)
move_2 = Move(Geometry=graft(move.Geometry), Motion=unit_x)  # -> flatten(Geometry), Transform
number_slider_4 = Slider(64, range=0..1000)
multiplication = Multiplication(A=number_slider, B=16)
move_3 = Move(Geometry=graft(move_2.Geometry), Motion=unit_y)  # -> flatten(Geometry), Transform
series_2 = Series(Start=0, Step=1, Count=multiplication)
division = Division(A=multiplication, B="3")
jitter = Jitter(List=series_2, Jitter=1, Seed=number_slider_3)  # -> Values, Indices
partition_list = PartitionList(List=jitter.Values, Size=division)
list_item = ListItem(List=move_3.Geometry, Index=partition_list, Wrap=True)
xz_plane = XZPlane(Origin=Point(0, 0, 0))
xy_plane = XYPlane(Origin=Point(0, 0, 0))
tree_statistics = TreeStatistics(Tree=list_item)  # -> Paths, Length, Count
list_item_2 = ListItem(List=tree_statistics.Paths, Index=0, Wrap=True)  # -> Item, Item1, Item2
tree_branch = TreeBranch(Tree=list_item, Path=list_item_2.Item, MaintainPaths=True)
tree_branch_2 = TreeBranch(Tree=list_item, Path=list_item_2.Item1, MaintainPaths=True)
tree_branch_3 = TreeBranch(Tree=list_item, Path=list_item_2.Item2, MaintainPaths=True)
rotate = Rotate(Geometry=tree_branch_3, Angle=degrees("90"), Plane=xz_plane)  # -> Geometry, Transform
rotate_2 = Rotate(Geometry=tree_branch_2, Angle=degrees("90"), Plane=xy_plane)  # -> Geometry, Transform
rotate_3 = Rotate(Geometry=tree_branch, Angle=degrees("90"), Plane=xy_plane)  # -> Geometry, Transform
